# Grasshopper definition poiRegression.gh (Grasshopper 0.9.76)
# plug-ins: Bifocals

curve = Curve(<curve referenced from the Rhino model>)
curve_2 = Curve(<curve referenced from the Rhino model>)
curve_3 = Curve(<curve referenced from the Rhino model>)
curve_4 = Curve(<curve referenced from the Rhino model>)
curve_5 = Curve(<curve referenced from the Rhino model>)
curve_6 = Curve(<curve referenced from the Rhino model>)
merge = Merge(Data1=curve_5, Data2=curve_6)
flip_curve = FlipCurve(Curve=curve_3)  # -> Curve, Flag
populate_geometry = PopulateGeometry(Geometry=curve_2, Count=Slider(166, range=0..2000), Seed=Slider(880.25, range=0..2000))
populate_geometry_2 = PopulateGeometry(Geometry=curve, Count=Slider(166, range=0..2000), Seed=Slider(880.25, range=0..2000))
sweep2 = Sweep2(Rail1=flip_curve.Curve, Rail2=curve_4, Sections=merge, SameHeight=False)
panel = Panel(populate_geometry_2)
populate_geometry_3 = PopulateGeometry(Geometry=sweep2, Count=Slider(166, range=0..2000), Seed=Slider(880.25, range=0..2000))
project = Project(Geometry=sweep2, Plane=PlaneXY(0, 0, 0))  # -> Geometry, Transform
rectangle = Rectangle({Plane=PlaneXY(62.68217268, 0.9019635133, 0), Size=Domain2(u=0..35.12539333, v=0..34.27972828)})
boundary_surfaces = BoundarySurfaces(Edges=rectangle)
curve_7 = Curve(<curve referenced from the Rhino model>)
populate_geometry_4 = PopulateGeometry(Geometry=curve_7, Count=Slider(58, range=0..2000), Seed=Slider(880.25, range=0..2000))
populate_geometry_5 = PopulateGeometry(Geometry=boundary_surfaces, Count=Slider(340, range=0..2000), Seed=Slider(491.129, range=0..2000))
panel_2 = Panel(populate_geometry_4)
custom_preview = CustomPreview(Geometry=populate_geometry_4, Shader=ColourSwatch(SwatchColor=RGB(208, 78, 61)))
file_path = FilePath("D:\MUBENAcademy\pythonSystem\dataB\targetVariable.txt")
panel_3 = Panel(file_path)
read_file = ReadFile(File=file_path, PerLineParse=True)
text_split = TextSplit(Text=read_file, Separators=",")
deconstruct = Deconstruct(Point=populate_geometry_5)  # -> XComponent, YComponent, ZComponent
param_viewer = ParamViewer(text_split)
construct_point = ConstructPoint(XCoordinate=populate_geometry_4, YCoordinate=text_split, ZCoordinate=0)
colour_swatch = ColourSwatch(SwatchColor=RGB(0, 0, 0))
panel_4 = Panel(text_split)
custom_preview_2 = CustomPreview(Geometry=construct_point, Shader=colour_swatch)
dot_display = DotDisplay(Point=construct_point, Colour=colour_swatch, Size=Slider(0.233, range=0..1))
delaunay_mesh = DelaunayMesh(Points=construct_point, Plane=PlaneXY(0, 0, 0))
mesh = Mesh(delaunay_mesh)
