# Grasshopper definition vegetationPlanNote.gh (Grasshopper 0.9.76)
# plug-ins: Bifocals

vegetitionpred_txt = FilePath("D:\MUBENAcademy\pythonSystem\dataB\vegetitionPred.txt")
predunique_txt = FilePath("D:\MUBENAcademy\pythonSystem\dataB\predUnique.txt")

geometry_pipeline = GeometryPipeline(
    GroupByLayer=False,
    GroupByType=False,
    IncludeHidden=True,
    IncludeLocked=True,
    LayerFilter="regionB",
    NameFilter="*",
    TypeFilter=4)
xy_plane = XYPlane(Origin=Point(0, 0, 0))
project = Project(Geometry=geometry_pipeline, Plane=xy_plane)  # -> Geometry, Transform
curve = Curve(project.Geometry)
boundary_surfaces = BoundarySurfaces(Edges=curve)
area = Area(Geometry=curve)  # -> Area, Centroid
expression = Expression(radius=Slider(5, range=0..15.001), area=area.Area, alpha=Slider(0.035, range=0..1), Expression="area/radius²*π*alpha")
populate_geometry = PopulateGeometry(Geometry=boundary_surfaces, Count=expression, Seed=Slider(87.52, range=0..500))
# 读入DBSCAN密度空间聚类后的.txt文件
number_slider = Slider(0.154, range=0..1)
jitter = Jitter(List=populate_geometry, Jitter=1, Seed=Slider(215.063, range=0..500))  # -> Values, Indices
multiplication = Multiplication(A=expression, B=number_slider)  # -> graft(Result)
random_reduce = RandomReduce(List=jitter.Values, Reduction=multiplication, Seed=Slider(150.976, range=0..500))
read_file = ReadFile(File=vegetitionpred_txt, PerLineParse=True)
read_file_2 = ReadFile(File=predunique_txt, PerLineParse=True)
tree_statistics = TreeStatistics(Tree=random_reduce)  # -> Paths, Length, Count
round = Round(Number=read_file)  # -> Nearest, Floor, Ceiling
round_2 = Round(Number=read_file_2)  # -> Nearest, graft(Floor), Ceiling
mass_addition = MassAddition(Input=tree_statistics.Length)  # -> Result, PartialResults
equality = Equality(FirstNumber=round_2.Floor, SecondNumber="-1")  # -> Equality, Inequality
# 写入vegetitionCluster.txt
panel = Panel(random_reduce)
panel_2 = Panel(mass_addition.Result)
tree_statistics_2 = TreeStatistics(Tree=round_2.Floor)  # -> Paths, Length, Count
panel_3 = Panel(round_2.Floor)
boolean_toggle = BooleanToggle(True)
boolean_toggle_2 = BooleanToggle(True)
cull_pattern = CullPattern(List=round_2.Floor, CullPattern=equality.Inequality)
cull_pattern_2 = CullPattern(List=round_2.Floor, CullPattern=equality.Equality)
clean_tree = CleanTree(RemoveNulls=boolean_toggle_2, RemoveInvalid=boolean_toggle_2, RemoveEmpty=boolean_toggle_2, Tree=cull_pattern_2)
clean_tree_2 = CleanTree(RemoveNulls=boolean_toggle, RemoveInvalid=boolean_toggle, RemoveEmpty=boolean_toggle, Tree=cull_pattern)
equality_2 = Equality(FirstNumber=round.Floor, SecondNumber=clean_tree_2)  # -> Equality, Inequality
equality_3 = Equality(FirstNumber=round.Floor, SecondNumber=clean_tree)  # -> Equality, Inequality
flatten_tree = FlattenTree(Tree=random_reduce, Path="{0}")
cull_pattern_3 = CullPattern(List=flatten_tree, CullPattern=equality_2.Equality)
cull_pattern_4 = CullPattern(List=flatten_tree, CullPattern=equality_3.Equality)
tree_statistics_3 = TreeStatistics(Tree=cull_pattern_3)  # -> Paths, Length, Count
construct_domain = ConstructDomain(DomainStart=Slider(28.238, range=0..50), DomainEnd=Slider(151.667, range=0..200))
dot_display = DotDisplay(Point=cull_pattern_4, Colour=ColourSwatch(SwatchColor=RGB(0, 0, 0)), Size=Slider(2.72, range=0..10))
construct_domain_2 = ConstructDomain(DomainStart=Slider(1536.036, range=0..10000), DomainEnd=Slider(5272.583, range=0..10000))
random = Random(Range=construct_domain, Number=tree_statistics_3.Count, Seed=Slider(67.344, range=0..200))
param_viewer = ParamViewer(cull_pattern_3)
random_2 = Random(Range=construct_domain_2, Number=tree_statistics_3.Length, Seed=random)
metaball_t_custom = MetaBallTCustom(Points=cull_pattern_3, Charge=random_2, Plane=PlaneXY(0, 0, 0), Threshold=Slider(139.45, range=0..500))
custom_preview = CustomPreview(Geometry=metaball_t_custom, Shader=ColourSwatch(SwatchColor=RGB(0, 0, 0)))

全部种植点 = Point(flatten_tree)
林缘线内种植点 = Point(cull_pattern_3)

stream_filter = StreamFilter(Gate=Toggle(True), Stream0=全部种植点, Stream1=林缘线内种植点)

point = Point(simplify(graft(stream_filter)))
closest_points = ClosestPoints(Point=point, Cloud=flatten(point), Count=Slider(2, range=0..9))  # -> ClosestPoint, CPIndex, Distance
list_item = ListItem(List=closest_points.ClosestPoint, Index="1", Wrap=True)
distance = Distance(PointA=point, PointB=list_item)
larger_than = LargerThan(FirstNumber=distance, SecondNumber=Slider(4.084, range=0..20))  # -> LargerThan, OrEqualTo
cull_pattern_5 = CullPattern(List=flatten(distance), CullPattern=flatten(larger_than.LargerThan))  # -> graft(List)
cull_pattern_6 = CullPattern(List=flatten(point), CullPattern=flatten(larger_than.LargerThan))  # -> graft(List)
division = Division(A=cull_pattern_5, B="2")
flatten_tree_2 = FlattenTree(Tree=division, Path="{0}")
dot_display_2 = DotDisplay(Point=cull_pattern_6, Colour=ColourSwatch(SwatchColor=RGB(0, 0, 0)), Size=Slider(1, range=0..1))
larger_than_2 = LargerThan(FirstNumber=flatten_tree_2, SecondNumber=Slider(11.799, range=0..20))  # -> LargerThan, OrEqualTo
item_index = ItemIndex(List=larger_than_2.LargerThan, Item=larger_than_2.LargerThan)
cull_pattern_7 = CullPattern(List=item_index, CullPattern=larger_than_2.LargerThan)
construct_domain_3 = ConstructDomain(DomainStart=Slider(7, range=0..20), DomainEnd=Slider(8.28, range=0..20))
list_length = ListLength(List=cull_pattern_7)
bounds = Bounds(Numbers=flatten(division))
random_3 = Random(Range=construct_domain_3, Number=list_length, Seed=Slider(190, range=0..500))
average = Average(Input=flatten(division))
deconstruct_domain = DeconstructDomain(Domain=bounds)  # -> Start, End
replace_items = ReplaceItems(List=flatten_tree_2, Item=random_3, Indices=cull_pattern_7, Wrap=False)  # -> graft(List)
# 读入自定义的plantlist.txt文件
平均半径 = 平均半径(average)
最小半径 = 最小半径(deconstruct_domain.Start)
最大半径 = 最大半径(deconstruct_domain.End)
circle = Circle(Plane=cull_pattern_6, Radius=replace_items)
panel_4 = Panel(average)
panel_5 = Panel(deconstruct_domain.Start)
panel_6 = Panel(deconstruct_domain.End)

plantlist_txt = FilePath("D:\MUBENAcademy\pythonSystem\dataB\plantlist.txt")
curve_2 = Curve(<curve referenced from the Rhino model>)

read_file_3 = ReadFile(File=plantlist_txt, PerLineParse=True)
text_split = TextSplit(Text=read_file_3, Separators=",")
jitter_2 = Jitter(List=flatten(circle), Jitter=Slider(0.2, range=0..1), Seed=Slider(42.85, range=0..100))  # -> Values, Indices
list_item_2 = ListItem(List=text_split, Index=0, Wrap=True)
graft_tree = GraftTree(Tree=jitter_2.Values, IncludeEmptyLists=True, IncludeNullItems=True)
list_length_2 = ListLength(List=jitter_2.Values)
list_item_3 = ListItem(List=text_split, Index=1, Wrap=True)
boundary_surfaces_2 = BoundarySurfaces(Edges=graft_tree)  # -> flatten(Surfaces)
multiplication_2 = Multiplication(A=flatten(list_item_3), B=list_length_2)
round_3 = Round(Number=multiplication_2)  # -> Nearest, Floor, Ceiling
partition_list = PartitionList(List=boundary_surfaces_2, Size=round_3.Nearest)
param_viewer_2 = ParamViewer(partition_list)
tree_statistics_4 = TreeStatistics(Tree=partition_list)  # -> Paths, Length, Count
colour_wheel = ColourWheel(
    tree_statistics_4.Count,
    ColourGrips_Style=20,
    ColourGrips_Grip=[0.6542944852, 2.10093672, 2.121791945, 5.263384598],
    ColourGrips_Lum=[0.08063701663, 0.5310564082],
    ColourGrips_Range=[0.5550657221, 0.5751401522, 0.607635307, 0.607635307],
    ColourGrips_Sat=[0.1926286293, 0.7975333383])
split_argb = SplitARGB(Colour=colour_wheel)  # -> Alpha, Red, Green, Blue
colour_rgb_f = ColourRGBF(Alpha=Slider(129.335, range=0..255), Red=split_argb.Red, Green=split_argb.Green, Blue=split_argb.Blue)
custom_preview_2 = CustomPreview(Geometry=partition_list, Shader=graft(colour_rgb_f))
legend = Legend(Colour=colour_rgb_f, Tags=flatten(list_item_2), Rectangle=curve_2, LegendType=1)
