# Grasshopper definition driverlessCityProject_import data.gh (Grasshopper 1.0.7)
# plug-ins: Bifocals, ElkGHComponents

file_path = FilePath("C:\Users\richi\omen-richiebao\omen-grasshopper\data\iit+map.osm")
# .import OSM
location = Location(FilePathText=file_path)  # -> OSMPointData, OSMFile, LongitudeDomain, LatitudeDomain
osm_data = OSMData(OSMPointData=location.OSMPointData, OSMFilePath=file_path, Feature="building", Generate3d=True, IndividualOutputs=False)  # -> Ways, Buildings, FeatureKey
topography = Topography()  # -> FileInfo, Points, Curves, Surface
geometry = Geometry(osm_data.Buildings)

locations = FilePath("C:\Users\richi\omen-richiebao\omen-grasshopper\location.csv")
landmarks = FilePath("C:\Users\richi\omen-richiebao\omen-grasshopper\landmarks.csv")
phmi = FilePath("C:\Users\richi\omen-richiebao\omen-grasshopper\phmi.csv")

mesh = Mesh(<mesh referenced from the Rhino model>)
curve = Curve(<curve referenced from the Rhino model>)

polyline = PolyLine(Vertices=osm_data.Ways, Closed=False)
panel = Panel(osm_data.FeatureKey)
custom_preview = CustomPreview(Geometry=geometry, Material=ColourSwatch(SwatchColor=RGB(224, 220, 220)))
loft_options = LoftOptions(Closed=True, Adjust=False, Rebuild=0, Refit=0, Type=0)

# ----
# .align with the actual initial point
point_aligned_with = Point(Point(936.5136883, 908.0976206, 3.080652894))

# ----
# .simulation data
# .driverless car 3d model
# .epoch
number_slider = Slider(811, range=0..2216)
bounding_box = BoundingBox(Content=mesh, Plane=PlaneXY(0, 0, 0))  # -> Box, Box_2
lidar_onboars_data = GhPythonScript(landmarks=landmarks, locations=locations, phmiP=phmi)  # -> landmark_x, landmark_y, location_x, location_y, phmi
# ---------- lidar_onboars_data: Python ----------
"""project:IIT(driverless city project)"""

__author__ = "richi bao"
__version__ = "2020.06.10"

import rhinoscriptsyntax as rs
import csv

import csv
landmark_x=[]
landmark_y=[]
location_x=[]
location_y=[]
phmi=[]
with open (landmarks) as csvfile:
    csvreader = csv.reader(csvfile, delimiter=',')
    i=0
    for row in csvreader:
        if i==0:pass
        else:
            landmark_x.append(float(row[0]))
            landmark_y.append(float(row[1]))

        i+=1
with open (locations) as csvfile:
    csvreader = csv.reader(csvfile, delimiter=',')
    i=0
    for row in csvreader:
        if i==0:pass
        else:
            location_x.append(float(row[0]))
            location_y.append(float(row[1]))
        i+=1
with open (phmiP) as csvfile:
    csvreader = csv.reader(csvfile, delimiter=',')
    i=0
    for row in csvreader:
        if i==0:pass
        else:
            phmi.append(float(row[0]))
        i+=1
# ---------- end lidar_onboars_data ----------
brep_edges = BrepEdges(Brep=bounding_box.Box)  # -> Naked, Interior, NonManifold
panel_2 = Panel("""0
2""")
construct_point = ConstructPoint(XCoordinate=lidar_onboars_data.location_x, YCoordinate=lidar_onboars_data.location_y, ZCoordinate="0")
construct_point_2 = ConstructPoint(XCoordinate=lidar_onboars_data.landmark_x, YCoordinate=lidar_onboars_data.landmark_y, ZCoordinate="0")
list_item = ListItem(List=brep_edges.Interior, Index=panel_2, Wrap=True)
evaluate_length = EvaluateLength(Curve=list_item, Length=Slider(0.5, range=0..1), Normalized=True)  # -> Point, Tangent, Parameter
explode_tree = ExplodeTree(Data=graft(evaluate_length.Point))  # -> _0000, _0001
vector_2pt = Vector2Pt(PointA=explode_tree._0001, PointB=explode_tree._0000, Unitize=False)  # -> Vector, Length
number = Number(number_slider)
line = Line(StartPoint=explode_tree._0001, EndPoint=explode_tree._0000)
vector_display = VectorDisplay(Anchor=explode_tree._0001, Vector=vector_2pt.Vector)
addition = Addition(A=number, B="1")
evaluate_length_2 = EvaluateLength(Curve=line, Length=Slider(0.5, range=0..1), Normalized=True)  # -> Point, Tangent, Parameter

list_item_2 = ListItem(List=construct_point, Index=0, Wrap=True)
vector_2pt_2 = Vector2Pt(PointA=list_item_2, PointB=point_aligned_with, Unitize=False)  # -> Vector, Length
entwine = Entwine(Branch00=construct_point_2, Branch01=construct_point, FlattenInputs=True)
group = Group(Objects=entwine)
move = Move(Geometry=group, Motion=vector_2pt_2.Vector)  # -> Geometry, Transform
rotate = Rotate(Geometry=move.Geometry, Angle=Slider(3.101, range=0..3.141), Plane=point_aligned_with)  # -> Geometry, Transform
ungroup = Ungroup(Group=rotate.Geometry)
explode_tree_2 = ExplodeTree(Data=ungroup)  # -> Branch0, Branch1
param_viewer = ParamViewer(explode_tree_2.Branch0)

point = Point(explode_tree_2.Branch0)
point_2 = Point(explode_tree_2.Branch1)
cloud_display = CloudDisplay(Points=point, Colours=ColourSwatch(SwatchColor=RGB(255, 36, 36)), Size=1, SpriteType=0)
cloud_display_2 = CloudDisplay(Points=point_2, Colours=ColourSwatch(SwatchColor=RGB(48, 41, 41)), Size=Slider(0.031, range=0..1), SpriteType=0)
point_3 = Point(point_2)
polyline_2 = PolyLine(Vertices=point_2, Closed=False)
list_item_3 = ListItem(List=point_3, Index=number, Wrap=True)
list_item_4 = ListItem(List=point_3, Index=addition, Wrap=True)
list_item_5 = ListItem(List=point_3, Index=number, Wrap=True)
vector_2pt_3 = Vector2Pt(PointA=list_item_3, PointB=list_item_4, Unitize=False)  # -> Vector, Length
vector_2pt_4 = Vector2Pt(PointA=evaluate_length_2.Point, PointB=list_item_5, Unitize=False)  # -> Vector, Length
move_2 = Move(Geometry=curve, Motion=vector_2pt_4.Vector)  # -> Geometry, Transform
evaluate_length_3 = EvaluateLength(Curve=move_2.Geometry, Length=0.5, Normalized=True)  # -> Point, Tangent, Parameter
move_3 = Move(Geometry=mesh, Motion=vector_2pt_4.Vector)  # -> Geometry, Transform
vector_display_ex = VectorDisplayEx(Point=list_item_3, Vector=vector_2pt_3.Vector, Colour=RGB(0, 0, 0), Width=2)
angle = Angle(VectorA=move_2.Geometry, VectorB=vector_2pt_3.Vector)  # -> Angle, Reflex
dot_display = DotDisplay(Point=evaluate_length_3.Point, Colour=RGB(0, 0, 0), Size=Slider(0.236, range=0..1))
xy_plane = XYPlane(Origin=evaluate_length_3.Point)
circle = Circle(Plane=evaluate_length_3.Point, Radius=Slider(25, range=0..50))
rotate_2 = Rotate(Geometry=move_3.Geometry, Angle=angle.Angle, Plane=xy_plane)  # -> Geometry, Transform
point_in_curve = PointInCurve(Point=point, Curve=circle)  # -> Relationship, Point

evaluate_length_4 = EvaluateLength(Curve=circle, Length=0.5, Normalized=True)  # -> Point, Tangent, Parameter

line_2 = Line(StartPoint=evaluate_length_3.Point, EndPoint=evaluate_length_4.Point)
line_dimension = LineDimension(Line=line_2, Text="{0:0.00}", Size=1)

equality = Equality(FirstNumber=point_in_curve.Relationship, SecondNumber="2")  # -> Equality, Inequality
cull_pattern = CullPattern(List=point_in_curve.Point, CullPattern=equality.Equality)
item_index = ItemIndex(List=cull_pattern, Item=cull_pattern)
sort_along_curve = SortAlongCurve(Points=cull_pattern, Curve=polyline_2)  # -> Points, Indices
line_3 = Line(StartPoint=evaluate_length_3.Point, EndPoint=cull_pattern)
text_tag = TextTag(Location=sort_along_curve.Points, Text=item_index, Colour=ColourSwatch(SwatchColor=RGB(8, 8, 8)))
cloud_display_3 = CloudDisplay(
    Points=sort_along_curve.Points,
    Colours=ColourSwatch(SwatchColor=RGB(67, 92, 222)),
    Size=Slider(2.477, range=0..10),
    SpriteType=0)
custom_preview_2 = CustomPreview(Geometry=line_3, Material=ColourSwatch(SwatchColor=RGB(38, 36, 36)))
list_length = ListLength(List=sort_along_curve.Points)
number_2 = Panel(list_length)
concatenate = Concatenate(FragmentA="total number:", FragmentB=list_length)
evaluate_length_5 = EvaluateLength(Curve=circle, Length=Slider(0.428, range=0..1), Normalized=True)  # -> Point, Tangent, Parameter
panel_3 = Panel(concatenate)
text_tag_3d = TextTag3D(
    Location=evaluate_length_5.Point,
    Text=concatenate,
    Size=Slider(1.416, range=0..10),
    Colour=ColourSwatch(SwatchColor=RGB(0, 0, 0)),
    Justification=7)

seam = Seam(Curve=circle, Seam=Slider(0.77, range=0..1))
divide_curve = DivideCurve(Curve=seam, Count=Slider(36, range=0..50), Kinks=False)  # -> Points, Tangents, Parameters
point_4 = Point(evaluate_length_3.Point)
line_4 = Line(StartPoint=point_4, EndPoint=divide_curve.Points)
loft = Loft(Curves=line_4, Options=loft_options)
custom_preview_3 = CustomPreview(Geometry=line_4, Material=ColourSwatch(SwatchColor=RGB(217, 217, 217)))

number_3 = Number(lidar_onboars_data.phmi)
panel_4 = Panel(number_3)
list_item_6 = ListItem(List=number_3, Index=number_slider, Wrap=True)
point_5 = Point(point_2)
unit_z = UnitZ(Factor=point_5)
multiplication = Multiplication(A=number_3, B=Slider(6.097, range=0..10))
amplitude = Amplitude(Vector=unit_z, Amplitude=multiplication)
evaluate_length_6 = EvaluateLength(Curve=circle, Length=Slider(0.458, range=0..1), Normalized=True)  # -> Point, Tangent, Parameter
concatenate_2 = Concatenate(FragmentA="PHMI:", FragmentB=list_item_6)
move_4 = Move(Geometry=point_5, Motion=amplitude)  # -> Geometry, Transform
polyline_3 = PolyLine(Vertices=move_4.Geometry, Closed=False)
custom_preview_4 = CustomPreview(Geometry=polyline_3, Material=ColourSwatch(SwatchColor=RGB(0, 0, 0)))

power_of_10 = PowerOf10(Value="-5")
number_4 = Number(lidar_onboars_data.phmi)
panel_5 = Panel(power_of_10)
smaller_than = SmallerThan(FirstNumber=list_item_6, SecondNumber=power_of_10)  # -> SmallerThan, OrEqualTo
smaller_than_2 = SmallerThan(FirstNumber=number_4, SecondNumber=power_of_10)  # -> SmallerThan, OrEqualTo
cull_pattern_2 = CullPattern(List=move_4.Geometry, CullPattern=smaller_than_2.SmallerThan)
panel_6 = Panel(smaller_than_2.SmallerThan)
dot_display_2 = DotDisplay(Point=cull_pattern_2, Colour=ColourSwatch(SwatchColor=RGB(81, 0, 255)), Size=Slider(0.268, range=0..1))

stream_filter = StreamFilter(
    Gate=smaller_than.SmallerThan,
    Stream0=ColourSwatch(SwatchColor=RGB(0, 0, 0)),
    Stream1=ColourSwatch(SwatchColor=RGB(204, 39, 219)))
text_tag_3d_2 = TextTag3D(
    Location=evaluate_length_6.Point,
    Text=concatenate_2,
    Size=Slider(1.416, range=0..10),
    Colour=stream_filter,
    Justification=7)
