# Grasshopper definition driverlessCityProject_genertePattern_final.gh (Grasshopper 1.0.7)
# plug-ins: atit, Bifocals

g_d_landmarks_25 = FilePath("C:\Users\richi\omen-richiebao\omen-grasshopper\landmarksGeneration\G_Distance_landmarks_25.csv")
g_d_landmarks_10 = FilePath("C:\Users\richi\omen-richiebao\omen-grasshopper\landmarksGeneration\G_Distance_landmarks_10.csv")
g_d_landmarks_6 = FilePath("C:\Users\richi\omen-richiebao\omen-grasshopper\landmarksGeneration\G_Distance_landmarks_6.csv")
g_d_landmarks_3 = FilePath("C:\Users\richi\omen-richiebao\omen-grasshopper\landmarksGeneration\G_Distance_landmarks_3.csv")
g_d_landmarks_50 = FilePath("C:\Users\richi\omen-richiebao\omen-grasshopper\landmarksGeneration\G_Distance_landmarks_50.csv")

g_landmarks_12 = FilePath("C:\Users\richi\omen-richiebao\omen-grasshopper\landmarksGeneration\G_Direction_landmarks_12.csv")
g_landmarks_24 = FilePath("C:\Users\richi\omen-richiebao\omen-grasshopper\landmarksGeneration\G_Direction_landmarks_24.csv")
g_landmarks_18 = FilePath("C:\Users\richi\omen-richiebao\omen-grasshopper\landmarksGeneration\G_Direction_landmarks_18.csv")
g_landmarks_36 = FilePath("C:\Users\richi\omen-richiebao\omen-grasshopper\landmarksGeneration\G_Direction_landmarks_36.csv")
g_landmarks_45 = FilePath("C:\Users\richi\omen-richiebao\omen-grasshopper\landmarksGeneration\G_Direction_landmarks_45.csv")

file_path = FilePath("C:\Users\richi\omen-richiebao\omen-grasshopper\cloud_pts.csv")
panel = Panel(file_path)
read_file = ReadFile(File=file_path, PerLineParse=True)
alexis_lm = FilePath("C:\Users\richi\omen-richiebao\omen-grasshopper\02\landmarks.csv")
cull_index = CullIndex(List=read_file, Indices=0, Wrap=True)
text_split = TextSplit(Text=cull_index, Separators=",")

file_path_2 = FilePath("C:\Users\richi\omen-richiebao\omen-grasshopper\data\iit+map.osm")  # disabled
osm_trace = Osm_Trace(OsmFilePath=file_path_2, Lat_Range=100, Long_Range=100, UTMWGS84=True)  # -> Osm_IDs, IsOsm_Bldg, Osm_Trace, KeyValue; disabled
the_original_point_reference = Point(Point(447925.3158, 4631998.387, 3.080652894))  # disabled
panel_2 = Panel("0")  # disabled
construct_point = ConstructPoint(XCoordinate=panel_2, YCoordinate=panel_2, ZCoordinate=panel_2)  # disabled
vector_2pt = Vector2Pt(PointA=the_original_point_reference, PointB=construct_point, Unitize=False)  # -> Vector, Length; disabled
move = Move(Geometry=osm_trace.Osm_Trace, Motion=vector_2pt.Vector)  # -> Geometry, Transform; disabled
tree_statistics = TreeStatistics(Tree=osm_trace.KeyValue)  # -> Paths, Length, Count; disabled
cull_pattern = CullPattern(List=move.Geometry, CullPattern=osm_trace.IsOsm_Bldg)  # disabled
cull_pattern_2 = CullPattern(List=tree_statistics.Paths, CullPattern=osm_trace.IsOsm_Bldg)  # disabled
boundary_surfaces = BoundarySurfaces(Edges=cull_pattern)  # disabled
tree_branch = TreeBranch(Tree=osm_trace.KeyValue, Path=cull_pattern_2, MaintainPaths=True)  # disabled

landmarks = FilePath("C:\Users\richi\omen-richiebao\omen-grasshopper\landmarks.csv")
locations = FilePath("C:\Users\richi\omen-richiebao\omen-grasshopper\landmarksGeneration\location.csv")
phmi = FilePath("C:\Users\richi\omen-richiebao\omen-grasshopper\landmarksGeneration\phmi.csv")

landmarks_2 = FilePath("C:\Users\richi\omen-richiebao\omen-grasshopper\01\landmarks.csv")
locations_2 = FilePath("C:\Users\richi\omen-richiebao\omen-grasshopper\01\location.csv")
phmi_2 = FilePath("C:\Users\richi\omen-richiebao\omen-grasshopper\01\phmi.csv")

mesh = Mesh(<mesh referenced from the Rhino model>)

curve = Curve(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)

list_item = ListItem(List=text_split, Index="2", Wrap=True)
list_item_2 = ListItem(List=text_split, Index="3", Wrap=True)
list_item_3 = ListItem(List=text_split, Index="1", Wrap=True)
list_item_4 = ListItem(List=text_split, Index="4", Wrap=True)
boolean_toggle = BooleanToggle(True)
panel_3 = Panel(list_item_4)
file_path_3 = FilePath("C:\Users\richi\omen-richiebao\omen-grasshopper\buildingsC.shp")
panel_4 = Panel(g_landmarks_12)
sort_list = SortList(Keys=flatten(list_item_2))  # -> Keys, ValuesValuesA
feat_it = FeatIt(ShapefileShpPath=file_path_3)  # -> GeometryType, ProjectionType, Features
imp_it = ImpIt(ShapefileShpPath=file_path_3, Project2WGS84=False, TrueOrFalse=boolean_toggle)  # -> Shapes, Features

file_path_4 = FilePath("C:\Users\richi\omen-richiebao\omen-grasshopper\data\iit+map.osm")
osm_trace_2 = Osm_Trace(OsmFilePath=file_path_4, Lat_Range=100, Long_Range=100, UTMWGS84=True)  # -> Osm_IDs, IsOsm_Bldg, Osm_Trace, KeyValue
the_original_point_reference_2 = Point(Point(447925.3158, 4631998.387, 3.080652894))
construct_point_2 = ConstructPoint(XCoordinate="0", YCoordinate="0", ZCoordinate="0")
vector_2pt_2 = Vector2Pt(PointA=the_original_point_reference_2, PointB=construct_point_2, Unitize=False)  # -> Vector, Length
move_2 = Move(Geometry=osm_trace_2.Osm_Trace, Motion=vector_2pt_2.Vector)  # -> Geometry, Transform
tree_statistics_2 = TreeStatistics(Tree=osm_trace_2.KeyValue)  # -> Paths, Length, Count
cull_pattern_3 = CullPattern(List=move_2.Geometry, CullPattern=osm_trace_2.IsOsm_Bldg)
cull_pattern_4 = CullPattern(List=tree_statistics_2.Paths, CullPattern=osm_trace_2.IsOsm_Bldg)
custom_preview = CustomPreview(Geometry=move_2.Geometry, Material=ColourSwatch(SwatchColor=RGBA(230, 230, 230, 92)))
boundary_surfaces_2 = BoundarySurfaces(Edges=cull_pattern_3)
tree_branch_2 = TreeBranch(Tree=osm_trace_2.KeyValue, Path=cull_pattern_4, MaintainPaths=True)
custom_preview_2 = CustomPreview(Geometry=boundary_surfaces_2, Material=ColourSwatch(SwatchColor=RGB(125, 125, 125)))  # disabled

md_slider = MDSlider(
    SliderMode=0,
    slider_value=Point(0.7059623904, 1, 0.5),
    x_domain=Domain(0, 1),
    y_domain=Domain(0, 1),
    z_domain=Domain(0, 1))
list_item_5 = ListItem(List=sort_list.Keys, Index=0, Wrap=True)
addition = Addition(A=Slider(0, range=-100..100), B=list_item_5)
subtraction = Subtraction(A=list_item_2, B=addition)
construct_point_3 = ConstructPoint(XCoordinate=list_item_3, YCoordinate=list_item, ZCoordinate=subtraction)
list_item_6 = ListItem(List=feat_it.Features, Index=2, Wrap=True)
datavis_it = DataVisIt(Shapes=imp_it.Shapes, GetValueofFeature=list_item_6, TrueOrFalse=boolean_toggle)  # -> Polygon, Polyline, Point, AttValues
number_slider = Slider(193.105, range=0..360)
point = Point(Point(447998.4797, 4631653.846, 0))
point_2 = Point(Point(73.19851276, -344.3977551, 3.479974521))
panel_5 = Panel(list_item_6)
param_viewer = ParamViewer(construct_point_3)
colour_swatch = ColourSwatch(SwatchColor=RGB(150, 150, 150))  # disabled
multiplication = Multiplication(A=md_slider, B=Slider(4.25, range=0..10))
vector_2pt_3 = Vector2Pt(PointA=point, PointB=point_2, Unitize=False)  # -> Vector, Length

equality = Equality(FirstNumber=list_item_4, SecondNumber="6")  # -> Equality, Inequality
cull_pattern_5 = CullPattern(List=construct_point_3, CullPattern=equality.Equality)
custom_preview_3 = CustomPreview(Geometry=cull_pattern_5, Material=ColourSwatch(SwatchColor=RGB(181, 110, 110)))

equality_2 = Equality(FirstNumber=list_item_4, SecondNumber="5")  # -> Equality, Inequality
colour_swatch_2 = ColourSwatch(SwatchColor=RGB(106, 230, 39))
cull_pattern_6 = CullPattern(List=construct_point_3, CullPattern=equality_2.Equality)
custom_preview_4 = CustomPreview(Geometry=cull_pattern_6, Material=colour_swatch_2)

equality_3 = Equality(FirstNumber=list_item_4, SecondNumber="4")  # -> Equality, Inequality
colour_swatch_3 = ColourSwatch(SwatchColor=RGB(107, 196, 59))
cull_pattern_7 = CullPattern(List=construct_point_3, CullPattern=equality_3.Equality)
custom_preview_5 = CustomPreview(Geometry=cull_pattern_7, Material=colour_swatch_3)

equality_4 = Equality(FirstNumber=list_item_4, SecondNumber="2")  # -> Equality, Inequality
cull_pattern_8 = CullPattern(List=construct_point_3, CullPattern=equality_4.Equality)

equality_5 = Equality(FirstNumber=list_item_4, SecondNumber="3")  # -> Equality, Inequality
colour_swatch_4 = ColourSwatch(SwatchColor=RGB(96, 150, 66))
cull_pattern_9 = CullPattern(List=construct_point_3, CullPattern=equality_5.Equality)
custom_preview_6 = CustomPreview(Geometry=cull_pattern_9, Material=colour_swatch_4)

boundary_surfaces_3 = BoundarySurfaces(Edges=datavis_it.Polygon)
geometry = Geometry(datavis_it.Polygon)
text_join = TextJoin()
unit_z = UnitZ(Factor=datavis_it.AttValues)
custom_preview_7 = CustomPreview(Geometry=move.Geometry, Material=colour_swatch)  # disabled
colour_swatch_5 = ColourSwatch(SwatchColor=RGB(125, 125, 125))  # disabled
extrude = Extrude(Base=boundary_surfaces_3, Direction=unit_z)
param_viewer_2 = ParamViewer(unit_z)
custom_preview_8 = CustomPreview(Geometry=boundary_surfaces, Material=colour_swatch_5)  # disabled
move_3 = Move(Geometry=extrude, Motion=vector_2pt_3.Vector)  # -> Geometry, Transform
custom_preview_9 = CustomPreview(Geometry=cull_pattern_8, Material=ColourSwatch(SwatchColor=RGB(99, 99, 99)))
param_viewer_3 = ParamViewer(extrude)
panel_6 = Panel(datavis_it.AttValues)

osm_building_level_extraction = GhPythonScript()  # -> out, building_level_path, building_level_path_list, building_level; inputs osmKeyValue: tree; disabled
# ---------- osm_building_level_extraction: Python ----------
__author__ = "richie bao"
__version__ = "2020.06.24"

import rhinoscriptsyntax as rs
import ghpythonlib.treehelpers as th
import Rhino

x=osmKeyValue
building_level_path=[]
building_level_path_list=[]
building_level=[]

j=0
for i in range(x.BranchCount):
    branchList=x.Branch(i)
    bdL=[int(string.split(":")[-1]) for string in branchList if "building:levels:" in string]
    branchPath=x.Path(i)
    if bdL!=[]:
        building_level_path.append(branchPath)
        building_level.append(bdL[0])
        building_level_path_list.append(j)
    j+=1
    #print(branchPath)

    #if i ==20:break
# ---------- end osm_building_level_extraction ----------
panel_7 = Panel("3")  # disabled
list_item_7 = ListItem(Index=osm_building_level_extraction.building_level_path_list, Wrap=True)  # disabled
multiplication_2 = Multiplication(A=osm_building_level_extraction.building_level, B=panel_7)  # disabled
boundary_surfaces_4 = BoundarySurfaces(Edges=list_item_7)  # disabled
unit_z_2 = UnitZ(Factor=multiplication_2)  # disabled
panel_8 = Panel(multiplication_2)  # disabled
param_viewer_4 = ParamViewer(unit_z_2)  # disabled
param_viewer_5 = ParamViewer(boundary_surfaces_4)  # disabled
extrude_2 = Extrude(Base=boundary_surfaces_4, Direction=unit_z_2)  # disabled

number_slider_2 = Slider(31.344, range=0..100)
custom_preview_10 = CustomPreview(Geometry=move_3.Geometry, Material=ColourSwatch(SwatchColor=RGBA(232, 209, 209, 235)))
point_3 = Point(point_2)
point_4 = Point(Point(1176932.922, 1883298.671, 3.080652894))
point_5 = Point(Point(105.9966285, -241.7977756, 3.080652894))
entwine = Entwine(Branch00=cull_pattern_9, Branch01=cull_pattern_7, Branch02=cull_pattern_6, FlattenInputs=True)
vector_2pt_4 = Vector2Pt(PointA=point_4, PointB=point_5, Unitize=False)  # -> Vector, Length
merge = Merge(Data1=Slider(10, range=0..25), Data2=Slider(-15, range=-25.001..25))
move_4 = Move(Geometry=entwine, Motion=vector_2pt_4.Vector)  # -> Geometry, Transform
entwine_2 = Entwine(Branch00=colour_swatch_4, Branch01=colour_swatch_3, Branch02=colour_swatch_2, FlattenInputs=True)
custom_preview_11 = CustomPreview(Geometry=move_4.Geometry, Material=entwine_2)
panel_9 = Panel("""0
1""")
number_slider_3 = Slider(2.222, range=0..10)
absolute = Absolute(Value=number_slider_3)
addition_2 = Addition(A=absolute, B=Slider(1, range=0..1))
unit_z_3 = UnitZ(Factor=number_slider_3)
unit_z_4 = UnitZ(Factor=addition_2)
reverse = Reverse(Vector=unit_z_3)
extrude_3 = Extrude()
colour_picker = ColourPicker(PickedColour=RGBA(147, 227, 145, 116))
colour_picker_2 = ColourPicker(PickedColour=RGBA(122, 196, 169, 127))

# ----
# .simulation data
# .epoch
# .driverless car 3d model
number_slider_4 = Slider(647, range=0..650)
bounding_box = BoundingBox(Content=mesh, Plane=PlaneXY(0, 0, 0))  # -> Box, Box_2
lidar_onboars_data = GhPythonScript(landmarks=g_d_landmarks_6, locations=locations, phmiP=phmi)  # -> landmark_x, landmark_y, location_x, location_y, phmi
# ---------- lidar_onboars_data: Python ----------
"""project:IIT(driverless city project)"""

__author__ = "richi bao"
__version__ = "2020.06.10"

import rhinoscriptsyntax as rs
import csv

import csv
landmark_x=[]
landmark_y=[]
location_x=[]
location_y=[]
phmi=[]
with open (landmarks) as csvfile:
    csvreader = csv.reader(csvfile, delimiter=',')
    i=0
    for row in csvreader:
        if i==0:pass
        else:
            landmark_x.append(float(row[0]))
            landmark_y.append(float(row[1]))

        i+=1
with open (locations) as csvfile:
    csvreader = csv.reader(csvfile, delimiter=',')
    i=0
    for row in csvreader:
        if i==0:pass
        else:
            location_x.append(float(row[0]))
            location_y.append(float(row[1]))
        i+=1
with open (phmiP) as csvfile:
    csvreader = csv.reader(csvfile, delimiter=',')
    i=0
    for row in csvreader:
        if i==0:pass
        else:
            phmi.append(float(row[0]))
        i+=1
# ---------- end lidar_onboars_data ----------
brep_edges = BrepEdges(Brep=bounding_box.Box)  # -> Naked, Interior, NonManifold
panel_10 = Panel("""0
2""")
construct_point_4 = ConstructPoint(XCoordinate=lidar_onboars_data.landmark_x, YCoordinate=lidar_onboars_data.landmark_y, ZCoordinate="0")
construct_point_5 = ConstructPoint(XCoordinate=lidar_onboars_data.location_x, YCoordinate=lidar_onboars_data.location_y, ZCoordinate="0")
list_item_8 = ListItem(List=brep_edges.Interior, Index=panel_10, Wrap=True)
evaluate_length = EvaluateLength(Curve=list_item_8, Length=Slider(0.5, range=0..1), Normalized=True)  # -> Point, Tangent, Parameter
explode_tree = ExplodeTree(Data=graft(evaluate_length.Point))  # -> _0000, _0001
vector_2pt_5 = Vector2Pt(PointA=explode_tree._0001, PointB=explode_tree._0000, Unitize=False)  # -> Vector, Length
number = Number(number_slider_4)
line = Line(StartPoint=explode_tree._0001, EndPoint=explode_tree._0000)
vector_display = VectorDisplay(Anchor=explode_tree._0001, Vector=vector_2pt_5.Vector)
addition_3 = Addition(A=number, B="1")
evaluate_length_2 = EvaluateLength(Curve=line, Length=Slider(0.5, range=0..1), Normalized=True)  # -> Point, Tangent, Parameter

number_2 = Number(number_slider_4)
addition_4 = Addition(A=number_2, B=1)
subtraction_2 = Subtraction(A=number_2, B=1)
param_viewer_6 = ParamViewer(construct_point_5)

point_aligned_with = Point(Point(60.27854876, -374.3811217, 3.080652894))
list_item_9 = ListItem(List=construct_point_5, Index=0, Wrap=True)
vector_2pt_6 = Vector2Pt(PointA=list_item_9, PointB=point_aligned_with, Unitize=False)  # -> Vector, Length
entwine_3 = Entwine(Branch00=construct_point_4, Branch01=construct_point_5, FlattenInputs=True)
group = Group(Objects=entwine_3)
move_5 = Move(Geometry=group, Motion=vector_2pt_6.Vector)  # -> Geometry, Transform

# ----
# .align with the actual initial point
# case 1
number_slider_5 = Slider(267.486, range=0..360)
radians = Radians(Degrees=number_slider_5)
loft_options = LoftOptions(Closed=True, Adjust=False, Rebuild=0, Refit=0, Type=0)

rotate = Rotate(Geometry=move_5.Geometry, Angle=radians, Plane=point_aligned_with)  # -> Geometry, Transform
ungroup = Ungroup(Group=rotate.Geometry)
explode_tree_2 = ExplodeTree(Data=ungroup)  # -> Branch0, Branch1
param_viewer_7 = ParamViewer(explode_tree_2.Branch0)

point_6 = Point(explode_tree_2.Branch1)
point_7 = Point(explode_tree_2.Branch0)
cloud_display = CloudDisplay(Points=point_6, Colours=ColourSwatch(SwatchColor=RGB(3, 2, 2)), Size=Slider(0.031, range=0..1), SpriteType=0)
cloud_display_2 = CloudDisplay(Points=point_7, Colours=ColourSwatch(SwatchColor=RGB(255, 36, 36)), Size=1, SpriteType=0)
point_8 = Point(point_6)
polyline = PolyLine(Vertices=point_6, Closed=False)
list_item_10 = ListItem(List=point_8, Index=number, Wrap=True)
list_item_11 = ListItem(List=point_8, Index=addition_3, Wrap=True)
list_item_12 = ListItem(List=point_8, Index=number, Wrap=True)
vector_2pt_7 = Vector2Pt(PointA=evaluate_length_2.Point, PointB=list_item_12, Unitize=False)  # -> Vector, Length
vector_2pt_8 = Vector2Pt(PointA=list_item_10, PointB=list_item_11, Unitize=False)  # -> Vector, Length
move_6 = Move(Geometry=mesh, Motion=vector_2pt_7.Vector)  # -> Geometry, Transform
move_7 = Move(Geometry=curve, Motion=vector_2pt_7.Vector)  # -> Geometry, Transform
evaluate_length_3 = EvaluateLength(Curve=move_7.Geometry, Length=0.5, Normalized=True)  # -> Point, Tangent, Parameter
vector_display_ex = VectorDisplayEx(Point=list_item_10, Vector=vector_2pt_8.Vector, Colour=RGB(0, 0, 0), Width=2)
dot_display = DotDisplay(Point=evaluate_length_3.Point, Colour=RGB(0, 0, 0), Size=Slider(0.236, range=0..1))
xy_plane = XYPlane(Origin=evaluate_length_3.Point)
circle = Circle(Plane=evaluate_length_3.Point, Radius=Slider(25, range=0..50))
point_in_curve = PointInCurve(Point=point_7, Curve=circle)  # -> Relationship, Point

point_9 = Point(point_6)
list_item_13 = ListItem(List=point_8, Index=subtraction_2, Wrap=True)
list_item_14 = ListItem(List=point_8, Index=addition_4, Wrap=True)
point_10 = Point(list_item_12)
distance = Distance(PointA=point_10, PointB=list_item_13)
distance_2 = Distance(PointA=point_10, PointB=list_item_14)
panel_11 = Panel(distance_2)
addition_5 = Addition(A=point_10, B=multiplication)
panel_12 = Panel(distance)
concatenate = Concatenate(FragmentA=distance_2, FragmentB="    before|after    ")
concatenate_2 = Concatenate(FragmentA=concatenate, FragmentB=distance)
text_tag_3d = TextTag3D(
    Location=addition_5,
    Text=concatenate_2,
    Size=Slider(1.924, range=0..10),
    Colour=ColourSwatch(SwatchColor=RGB(156, 135, 135)),
    Justification=7)
panel_13 = Panel(concatenate_2)
line_2 = Line(StartPoint=list_item_10, EndPoint=list_item_11)
extend_curve = ExtendCurve(Curve=line_2, Type=0, Start=number_slider_2, End=number_slider_2)
curve_2 = Curve(circle)
curve_curve = CurveCurve(CurveA=curve_2, CurveB=extend_curve)  # -> Points, ParamsA, ParamsB
offset_curve = OffsetCurve(Curve=extend_curve, Distance=merge, Plane=PlaneXY(0, 0, 0), Corners=1)
flip_curve = FlipCurve(Curve=move_7.Geometry)  # -> Curve, Flag
list_item_15 = ListItem(List=curve_curve.ParamsA, Index=0, Wrap=True)

evaluate_length_4 = EvaluateLength(Curve=circle, Length=0.5, Normalized=True)  # -> Point, Tangent, Parameter
seam = Seam(Curve=circle, Seam=Slider(0.77, range=0..1))
divide_curve = DivideCurve(Curve=seam, Count=Slider(36, range=0..50), Kinks=False)  # -> Points, Tangents, Parameters
point_11 = Point(evaluate_length_3.Point)
line_3 = Line(StartPoint=point_11, EndPoint=divide_curve.Points)
loft = Loft(Curves=line_3, Options=loft_options)
custom_preview_12 = CustomPreview(Geometry=line_3, Material=ColourSwatch(SwatchColor=RGB(217, 217, 217)))

angle = Angle(VectorA=flip_curve.Curve, VectorB=vector_2pt_8.Vector)  # -> Angle, Reflex
rotate_2 = Rotate(Geometry=move_6.Geometry, Angle=angle.Angle, Plane=xy_plane)  # -> Geometry, Transform
line_4 = Line(StartPoint=evaluate_length_3.Point, EndPoint=evaluate_length_4.Point)
line_dimension = LineDimension(Line=line_4, Text="{0:0.00}", Size=1)

seam_2 = Seam(Curve=curve_2, Seam=list_item_15)
divide_curve_2 = DivideCurve(Curve=seam_2, Count=Slider(10, range=0..72), Kinks=False)  # -> Points, Tangents, Parameters
point_in_curve_2 = PointInCurve(Point=point_7, Curve=circle)  # -> Relationship, Point
point_12 = Point(evaluate_length_3.Point)
line_5 = Line(StartPoint=point_12, EndPoint=divide_curve_2.Points)
equality_6 = Equality(FirstNumber=point_in_curve_2.Relationship, SecondNumber="2")  # -> Equality, Inequality
vector = Vector(vector_2pt_8.Vector)
amplitude = Amplitude(Vector=vector, Amplitude=Slider(10, range=0..10))
dispatch = Dispatch(List=line_5, DispatchPattern=panel_9)  # -> ListA, ListB
cull_pattern_10 = CullPattern(List=point_in_curve_2.Point, CullPattern=equality_6.Equality)
curve_curve_2 = CurveCurve(CurveA=dispatch.ListB, CurveB=offset_curve)  # -> Points, ParamsA, ParamsB
vector_display_ex_2 = VectorDisplayEx(Point=list_item_10, Vector=amplitude, Colour=ColourSwatch(SwatchColor=RGB(13, 202, 219)), Width=2)
custom_preview_13 = CustomPreview(Geometry=dispatch.ListB, Material=ColourSwatch(SwatchColor=RGB(196, 177, 177)))
custom_preview_14 = CustomPreview(Geometry=dispatch.ListA, Material=ColourSwatch(SwatchColor=RGB(245, 27, 27)))

equality_7 = Equality(FirstNumber=point_in_curve.Relationship, SecondNumber="2")  # -> Equality, Inequality
cull_pattern_11 = CullPattern(List=point_in_curve.Point, CullPattern=equality_7.Equality)
sort_along_curve = SortAlongCurve(Points=cull_pattern_11, Curve=polyline)  # -> Points, Indices
item_index = ItemIndex(List=cull_pattern_11, Item=cull_pattern_11)
line_6 = Line(StartPoint=evaluate_length_3.Point, EndPoint=cull_pattern_11)
text_tag = TextTag(Location=sort_along_curve.Points, Text=item_index, Colour=ColourSwatch(SwatchColor=RGB(8, 8, 8)))
cloud_display_3 = CloudDisplay(
    Points=sort_along_curve.Points,
    Colours=ColourSwatch(SwatchColor=RGB(67, 92, 222)),
    Size=Slider(2.477, range=0..10),
    SpriteType=0)
custom_preview_15 = CustomPreview(Geometry=line_6, Material=ColourSwatch(SwatchColor=RGB(255, 255, 255)))
list_length = ListLength(List=sort_along_curve.Points)
concatenate_3 = Concatenate(FragmentA="total number:", FragmentB=list_length)
number_3 = Panel(list_length)
evaluate_length_5 = EvaluateLength(Curve=circle, Length=Slider(0.309, range=0..1), Normalized=True)  # -> Point, Tangent, Parameter
panel_14 = Panel(concatenate_3)
text_tag_3d_2 = TextTag3D(
    Location=evaluate_length_5.Point,
    Text=concatenate_3,
    Size=Slider(3.148, range=0..10),
    Colour=ColourSwatch(SwatchColor=RGB(0, 0, 0)),
    Justification=7)

curve_3 = Curve(dispatch.ListA)
shift_list = ShiftList(List=curve_3, Shift=1, Wrap=True)
entwine_4 = Entwine(Branch00=curve_3, Branch01=shift_list, FlattenInputs=True)
flip_matrix = FlipMatrix(Data=entwine_4)
loft_2 = Loft(Curves=flip_matrix, Options={Adjust=False, Closed=False, LoftEnds=0, LoftSimp=0, LoftType=0, Rebuild=10, Refit=0.01})  # -> flatten(Loft)
move_8 = Move(Geometry=loft_2, Motion=reverse)  # -> Geometry, Transform
point_13 = Point(sort_along_curve.Points)
extrude_4 = Extrude(Base=move_8.Geometry, Direction=unit_z_4)
point_in_breps = PointInBreps(Brep=extrude_4, Point=point_13, Strict=False)  # -> Inside, Index
param_viewer_8 = ParamViewer(point_13)
param_viewer_9 = ParamViewer(loft_2)
custom_preview_16 = CustomPreview(Geometry=loft_2, Material=colour_picker)
point_in_curves = PointInCurves(Point=point_13, Curves=loft_2)  # -> Relationship, Index, Point
remove_duplicated_numbers = GhPythonScript(nums=point_in_curves.Index)  # -> out, single_idx; inputs nums: list
# ---------- remove_duplicated_numbers: Python ----------
__author__ = "richie bao"
__version__ = "2020.07.02"

import rhinoscriptsyntax as rs
import copy
single_idx=[]
nums_copy=copy.deepcopy(nums)
for val in nums:
    if val not in single_idx and val !=-1:
        single_idx.append(val)
# ---------- end remove_duplicated_numbers ----------
equality_8 = Equality(FirstNumber=point_in_curves.Relationship, SecondNumber="2")  # -> Equality, Inequality
list_item_16 = ListItem(List=loft_2, Index=remove_duplicated_numbers.single_idx, Wrap=True)  # -> flatten(Item)
list_length_2 = ListLength(List=list_item_16)
custom_preview_17 = CustomPreview(Geometry=list_item_16, Material=colour_picker_2)
evaluate_length_6 = EvaluateLength(Curve=circle, Length=Slider(0.429, range=0..1), Normalized=True)  # -> Point, Tangent, Parameter
text_tag_3d_3 = TextTag3D(
    Location=evaluate_length_6.Point,
    Text=list_length_2,
    Size=Slider(6.216, range=0..10),
    Colour=ColourSwatch(SwatchColor=RGB(0, 0, 0)),
    Justification=7)

area = Area(Geometry=list_item_16)  # -> Area, Centroid
param_viewer_10 = ParamViewer(list_item_16)
closest_points = ClosestPoints(Point=area.Centroid, Cloud=area.Centroid, Count=Slider(10, range=0..10))  # -> ClosestPoint, CPIndex, Distance
param_viewer_11 = ParamViewer(closest_points.Distance)
panel_15 = Panel(closest_points.Distance)
panel_16 = Panel(area.Centroid)
equality_9 = Equality(FirstNumber=closest_points.Distance, SecondNumber="0")  # -> Equality, Inequality
list_item_17 = ListItem(List=closest_points.Distance, Index=Slider(3, range=0..10), Wrap=True)  # -> flatten(Item)
evaluate = Evaluate(Expression="if (x>0.01,True,False)", x=list_item_17)
cull_pattern_12 = CullPattern(List=closest_points.Distance, CullPattern=equality_9.Equality)
param_viewer_12 = ParamViewer(area.Centroid)
cull_pattern_13 = CullPattern(List=list_item_16, CullPattern=evaluate)
list_item_18 = ListItem(List=list_item_16, Index=Slider(7, range=0..10), Wrap=True)
param_viewer_13 = ParamViewer(cull_pattern_13)
panel_17 = Panel(cull_pattern_12)
param_viewer_14 = ParamViewer(cull_pattern_12)

area_2 = Area(Geometry=list_item_16)  # -> Area, Centroid
ghpython_script = GhPythonScript(pts=area_2.Centroid)  # -> out, pts_clean; inputs pts: list
# ---------- ghpython_script: Python ----------
__author__ = "richie bao"
__version__ = "2020.07.02"

import rhinoscriptsyntax as rs
import copy
#print(pts)
pts_clean=[]
pts_copy=copy.deepcopy(pts)
for p_ in pts_copy:
    pts.remove(p_)
    pts_clean.append(p_)
    for p in pts:
        if p_==p:
            pts.remove(p)
# ---------- end ghpython_script ----------

number_4 = Number(lidar_onboars_data.phmi)
scale_the_value_proportionally_to_show = Slider(23.142, range=0..100)
panel_18 = Panel(number_4)
list_item_19 = ListItem(List=number_4, Index=number_slider_4, Wrap=True)
point_14 = Point(point_6)
unit_z_5 = UnitZ(Factor=point_14)
multiplication_3 = Multiplication(A=number_4, B=scale_the_value_proportionally_to_show)
amplitude_2 = Amplitude(Vector=unit_z_5, Amplitude=multiplication_3)
evaluate_length_7 = EvaluateLength(Curve=circle, Length=Slider(0.458, range=0..1), Normalized=True)  # -> Point, Tangent, Parameter
concatenate_4 = Concatenate(FragmentA="PHMI:", FragmentB=list_item_19)
move_9 = Move(Geometry=point_14, Motion=amplitude_2)  # -> Geometry, Transform
polyline_2 = PolyLine(Vertices=move_9.Geometry, Closed=False)
custom_preview_18 = CustomPreview(Geometry=polyline_2, Material=ColourSwatch(SwatchColor=RGB(0, 0, 0)))

power_of_10 = PowerOf10(Value="-5")
number_5 = Number(lidar_onboars_data.phmi)
panel_19 = Panel(power_of_10)
smaller_than = SmallerThan(FirstNumber=list_item_19, SecondNumber=power_of_10)  # -> SmallerThan, OrEqualTo
smaller_than_2 = SmallerThan(FirstNumber=number_5, SecondNumber=power_of_10)  # -> SmallerThan, OrEqualTo
cull_pattern_14 = CullPattern(List=move_9.Geometry, CullPattern=smaller_than_2.SmallerThan)
panel_20 = Panel(smaller_than_2.SmallerThan)
dot_display_2 = DotDisplay(Point=cull_pattern_14, Colour=ColourSwatch(SwatchColor=RGB(81, 0, 255)), Size=Slider(0.268, range=0..1))

stream_filter = StreamFilter(
    Gate=smaller_than.SmallerThan,
    Stream0=ColourSwatch(SwatchColor=RGB(0, 0, 0)),
    Stream1=ColourSwatch(SwatchColor=RGB(204, 39, 219)))
text_tag_3d_4 = TextTag3D(
    Location=evaluate_length_7.Point,
    Text=concatenate_4,
    Size=Slider(1.416, range=0..10),
    Colour=stream_filter,
    Justification=7)
